# Grasshopper definition Temp.gh (Grasshopper 1.0.7)
# plug-ins: TJADSZY

crv = Curve(<curve referenced from the Rhino model>)
cp = ControlPoints(Curve=crv)  # -> Points, Weights, Knots
area = Area(Geometry=crv)  # -> Area, Centroid
cull_i = CullIndex(List=cp.Points, Indices=-1, Wrap=True)
cir = Circle(Plane=area.Centroid, Radius=1)
number_slider = Slider(1, range=0..1)
alongcrv = SortAlongCurve(Points=cull_i, Curve=cir)  # -> Points, Indices
crv_2 = Curve([<curve referenced from the Rhino model> x35])
crv_3 = Curve([<curve referenced from the Rhino model> x45])
crv_4 = Curve([<curve referenced from the Rhino model> x71])
gs = GenSchool(
    PlotRatio=number_slider,
    BoundaryPoints=alongcrv.Points,
    PlaygroundS=crv_4,
    PlaygroundM=crv_2,
    PlaygroundL=crv_3,
    DayFactor=number_slider)  # -> Test, Crv
c_script = CSharpScript(x=alongcrv.Points)  # -> out, A; inputs x: list of Point3d
# ---------- c_script: C# usings ----------
using Rhino.NodeInCode;
# ---------- c_script: C# ----------
    var polyline=Components.FindComponent("PolyLine").Delegate as dynamic;
    
    Curve tmp = polyline(x, true)[0];
    var area=Components.FindComponent("Area").Delegate as dynamic;
    A = area(tmp)[0];
# ---------- end c_script ----------
